# Requirement set req (R2025b)

## 1 [#1] Doer (Container)

### 1.1 [#14] کنترل دما
دمای هر اتاق باید به طور پیوسته بر اساس معادله دیفرانسیل داده شده محاسبه شود (شامل تاثیر همسایه‌ها، دمای بیرون و وضعیت بخاری).

### 1.2 [#15] منطق روشن/خاموش

#### 1.2.1 [#16] ترموستات روشن
اگر بخاری در اتاق i موجود باشد و دما کمتر یا مساوی حد پایین باشد، بخاری باید روشن شود

#### 1.2.2 [#17] ترموستات خاموش
اگر بخاری در اتاق i موجود باشد و دما بیشتر یا مساوی حد بالا باشد، بخاری باید خاموش شود

### 1.3 [#18] شرایط انتقال (Container)

#### 1.3.1 [#19] شرط وجود
بخاری تنها می‌تواند از اتاق j به i منتقل شود که اتاق i بخاری نداشته باشد و اتاق j بخاری داشته باشد.

#### 1.3.2 [#20] شرط دما
انتقال بخاری به اتاق i تنها زمانی مجاز است که دمای فعلی اتاق i کمتر از آستانه دریافت (geti​) باشد.

#### 1.3.3 [#21] شرط اختلاف
انتقال بخاری از j به i تنها زمانی مجاز است که اختلاف دما (xi​−xj​) کمتر از آستانه اختلاف (difi​) باشد

## 2 [#7] Checker (Container)
در هر لحظه از زمان، مجموع تعداد بخاری‌های فعال در کل خانه نباید بیشتر از ۲ عدد باشد
Keywords: safety

### 2.1 [#22] محدودیت تعداد بخاری
انتقال بخاری از j به i تنها زمانی مجاز است که اختلاف دما (xi​−xj​) کمتر از آستانه اختلاف (difi​) باشد

### 2.2 [#23] تأیید جابجایی
واحد ایمنی باید بررسی کند که جابجایی بخاری‌ها قوانین منطقی (مثل عدم وجود دو بخاری در یک اتاق) را نقض نکند.

## 3 [#8] بازه دمایی مطلوب
سیستم باید بتواند دمای تمام اتاق‌ها را در بازه ۱۵ تا ۲۰ درجه سانتی‌گراد نگه دارد.
Keywords: safety

## 4 [#24] Gateway Logic
فرمان نهایی بخاری (ActuatorActuatorActuator) باید برابر با فرمان واحد کنترل (DoerDoerDoer) باشد، مشروط بر اینکه واحد ایمنی (CheckerCheckerChecker) سیگنال تایید (ValidFlagValid FlagValidFlag) را صادر کرده باشد. در غیر این صورت، فرمان باید به حالت ایمن (Safe State / خاموش) برود.